# Grasshopper definition FacadeAuthoring with hops.gh (Grasshopper 1.0.8)
# plug-ins: Hops

# ----
# layout generator
number_slider = Slider(0.3, range=0..1)
xy_plane = XYPlane(Origin=Point(0, 0, 0))
python_3_script = Python3Script(
    face_plane=xy_plane,
    facade_w=Slider(600, range=0..1000),
    facade_h=Slider(420, range=0..1000),
    baseSize=Slider(30, range=0..100),
    sizes_text="1,2,3,5,8",
    seed=Slider(1, range=0..1),
    small_bias=number_slider)  # -> out, tile_planes, tile_w, tile_h, span, i_idx, j_idx, corner_id_suggest, rect_preview
# ---------- python_3_script: Python ----------
import random
from math import floor
import Rhino.Geometry as rg

# inputs:
# face_plane: rg.Plane
# facade_w, facade_h, baseSize: float (cm)
# sizes_text: str like "1,2,3,5,8"
# seed: int
# small_bias: 0..1

# outputs to define:
tile_planes, tile_w, tile_h, span, i_idx, j_idx = [], [], [], [], [], []
corner_id_suggest, rect_preview = [], []

# grid in base cells
nx = int(floor(facade_w / baseSize))
ny = int(floor(facade_h / baseSize))
if nx <= 0 or ny <= 0: 
    raise ValueError("facade size too small for baseSize")

# parse sizes, largest first
S = [int(s.strip()) for s in sizes_text.split(",") if s.strip().isdigit()]
S = sorted(set(S), reverse=True)
if not S: S = [1,2,3,5,8]
random.seed(int(seed))

used = [[False]*nx for _ in range(ny)]

def fits(i, j, s):
    if i + s > nx or j + s > ny: return False
    for jj in range(j, j+s):
        for ii in range(i, i+s):
            if used[jj][ii]: return False
    return True

def mark(i, j, s):
    for jj in range(j, j+s):
        for ii in range(i, i+s):
            used[jj][ii] = True

# scan top->bottom, left->right (Y first so visuals feel natural)
for j in range(ny):
    for i in range(nx):
        if used[j][i]: 
            continue
        chosen = None
        # choose largest that fits
        for s in S:
            if fits(i, j, s):
                chosen = s
                # smallness bias: sometimes step down to a smaller one that also fits
                idx = S.index(s)
                while random.random() < max(0.0, min(1.0, small_bias)) and idx < len(S)-1:
                    s2 = S[idx+1]
                    if fits(i, j, s2):
                        chosen = s2
                        idx += 1
                    else:
                        break
                break
        if chosen is None:
            # fallback: fill with 1 if possible
            if fits(i, j, 1): 
                chosen = 1
            else:
                continue

        mark(i, j, chosen)

        w = chosen * baseSize
        h = w
        # local center of this tile relative to face_plane origin (facade center)
        cx = -facade_w/2.0 + (i + chosen/2.0) * baseSize
        cy = -facade_h/2.0 + (j + chosen/2.0) * baseSize

        # plane at tile center, same axes as facade plane
        origin = face_plane.PointAt(cx, cy)
        tp = rg.Plane(origin, face_plane.XAxis, face_plane.YAxis)

        tile_planes.append(tp)
        tile_w.append(w); tile_h.append(h)
        span.append(chosen)
        i_idx.append(i); j_idx.append(j)

        # corner id suggestion for quarter‑rings so 2x2 blocks assemble circles
        # pattern by cell parity (works even when spans mix):
        # (even,even)->0, (odd,even)->1, (odd,odd)->2, (even,odd)->3
        cid = (i % 2) + 2 * (j % 2)
        corner_id_suggest.append(cid)

        # rectangle preview (in face_plane space)
        rx = rg.Interval(cx - w/2.0, cx + w/2.0)
        ry = rg.Interval(cy - h/2.0, cy + h/2.0)
        rect = rg.Rectangle3d(face_plane, rx, ry)
        rect_preview.append(rect.ToNurbsCurve())
# ---------- end python_3_script ----------

# ----
# tile context
python_3_script_2 = Python3Script(
    tile_planes=python_3_script.tile_planes,
    tile_w=python_3_script.tile_w,
    tile_h=python_3_script.tile_h,
    corner_id_suggest=python_3_script.corner_id_suggest)  # -> out, tile_ctx_json, count
# ---------- python_3_script_2: Python ----------
import json
import Rhino.Geometry as rg
import System.IO as IO

# ---------- helpers ----------
def flatten(xs):
    """Return a flat list. If xs is a single item (e.g., float), wrap it."""
    if xs is None:
        return []
    if not isinstance(xs, (list, tuple)):
        return [xs]
    out = []
    for x in xs:
        if isinstance(x, (list, tuple)):
            out.extend(flatten(x))
        else:
            out.append(x)
    return out

def mid(iv):
    try: return (iv.T0 + iv.T1) * 0.5
    except: return 0.5

def coerce_plane(obj):
    """Try to obtain a Plane from several geometry types."""
    # Plane
    if isinstance(obj, rg.Plane):
        return True, rg.Plane(obj)

    # Rectangle3d
    if isinstance(obj, rg.Rectangle3d):
        return True, rg.Plane(obj.Plane)

    # Planar curve
    if isinstance(obj, rg.Curve):
        ok, pl = obj.TryGetPlane(1e-6)
        if ok: return True, pl
        bb = obj.GetBoundingBox(True)
        if bb.IsValid:
            p = bb.Center
            return True, rg.Plane(p, rg.Vector3d.ZAxis)

    # Surface
    if isinstance(obj, rg.Surface):
        ok, pl = obj.TryGetPlane()
        if ok: return True, pl
        try:
            u = mid(obj.Domain(0)); v = mid(obj.Domain(1))
            ok, pl = obj.FrameAt(u, v)
            if ok: return True, pl
        except: pass

    # Brep (use first face)
    if isinstance(obj, rg.Brep) and obj.Faces.Count > 0:
        face = obj.Faces[0]
        ok, pl = face.TryGetPlane()
        if ok: return True, pl
        try:
            pt = face.PointAt(0.5, 0.5)
            n  = face.NormalAt(0.5, 0.5)
            if not n.IsZero:
                n.Unitize()
                return True, rg.Plane(pt, n)
        except: pass

    # Mesh: fit plane to vertices
    if isinstance(obj, rg.Mesh) and obj.Vertices.Count >= 3:
        pts = [rg.Point3d(v.X, v.Y, v.Z) for v in obj.Vertices]
        ok, pl = rg.Plane.FitPlaneToPoints(pts)
        if ok: return True, pl

    return False, None

def plane_to_dict(p):
    return {
        "origin":[p.OriginX, p.OriginY, p.OriginZ],
        "xaxis":[p.XAxis.X, p.XAxis.Y, p.XAxis.Z],
        "yaxis":[p.YAxis.X, p.YAxis.Y, p.YAxis.Z],
        "zaxis":[p.ZAxis.X, p.ZAxis.Y, p.ZAxis.Z]
    }

def as_list_num(xs, cast=float):
    return [cast(x) for x in flatten(xs)]

# ---------- read & sanitize inputs ----------
planes  = flatten(tile_planes)
ws      = as_list_num(tile_w, float)
hs      = as_list_num(tile_h, float)
corners = as_list_num(corner_id_suggest, int)

n = min(len(planes), len(ws), len(hs))
ctxs = []

for k in range(n):
    ok, pl = coerce_plane(planes[k])
    if not ok:
        # skip items we can't coerce to a plane
        continue

    corner = corners[k] if k < len(corners) else 0

    ctxs.append({
        "id": int(k),
        "plane": plane_to_dict(pl),
        "bbox_w": float(ws[k]),
        "bbox_h": float(hs[k]),
        "corner_id": int(corner)
    })

tile_ctx_json = json.dumps(ctxs, indent=2)
count = len(ctxs)

# ---------- optional save ----------
try:
    if save_path and str(save_path).strip():
        IO.File.WriteAllText(str(save_path), tile_ctx_json)
except Exception as e:
    # If you want to debug saving issues, uncomment:
    # print("Save error:", e)
    pass
# ---------- end python_3_script_2 ----------

# ----
# archetype + metrics
number_slider_2 = Slider(2, range=0..3)
hops = Hops(
    Face_plane=python_3_script.tile_planes,
    Tile_w=python_3_script.tile_w,
    Tile_h=python_3_script.tile_h,
    Archetype_id=number_slider_2,
    Frame_t=Slider(6, range=0..10),
    Bar_t=Slider(5, range=0..10),
    Ring_t=Slider(6, range=0..10),
    Corner_id=python_3_script.corner_id_suggest,
    Theta_deg=Slider(0, range=0..90),
    CacheResultsInMemory=True,
    CacheSolveResults=True,
    RemoteDefinitionLocation="C:\Users\user\Desktop\VS\RL_Voxel-Agent_PPO_V1\TileEvaluator.gh",
    RemoteSolveVersion=(0, 1, 0),
    ShowInput_Enabled=False,
    ShowInput_Path=False,
    SynchronousSolve=True)  # -> Metrics_json, Signature_raw, Preview_crv

panel = Panel(python_3_script_2.tile_ctx_json)
panel_2 = Panel(hops.Metrics_json)
panel_3 = Panel(hops.Signature_raw)
